# Requirement set PFCSystemeRequirements (R2021b)

## 1 [#32] ソフトウェア実装ハードウェア要件

### 1.1 [#33] クロック
制御周期XXusを考慮し、その時間内に少なくとも$$$ステップの処理が見積もられるため+++MHzのクロックを実現するMCUを選定すること。

### 1.2 [#34] AD変換
XXbitの分解能を持つAD変換器を有すること

### 1.3 [#35] PWM出力

#### 1.3.1 [#47] スイッチング周波数
100kHzでスイッチングすること

#### 1.3.2 [#48] PWM分解能

### 1.4 [#36] IOポート

## 2 [#1] 制御ソフトウェア要件
制御ソフトウェアは外部からの指令を受け付ける

### 2.1 [#28] 入力信号

#### 2.1.1 [#43] 外部システムからの入力信号

#### 2.1.2 [#44] 回路基板からの入力信号

### 2.2 [#30] 出力信号

#### 2.2.1 [#45] 外部システムへの出力信号

#### 2.2.2 [#46] 回路基板への出力信号

### 2.3 [#37] シーケンス制御（モード切替）

#### 2.3.1 [#41] 200V系高速充電モード

#### 2.3.2 [#42] 100V系充電モード

### 2.4 [#38] 連続時間制御

#### 2.4.1 [#39] 電圧制御系

#### 2.4.2 [#40] 電流制御系

#### 2.4.3 [#50] PLL（系統周波数・位相同期制御）

## 3 [#2] 電力変換回路要件

### 3.1 [#3] 入力要件
後述する子要件が全て達成されていること

#### 3.1.1 [#6] 入力電圧範囲

#### 3.1.2 [#13] 入力電流範囲

#### 3.1.3 [#7] 入力電力範囲

### 3.2 [#4] 出力要件

#### 3.2.1 [#9] 出力電圧範囲

#### 3.2.2 [#10] 出力電流範囲

#### 3.2.3 [#11] 出力電力範囲

### 3.3 [#5] 機能要件

#### 3.3.1 [#14] 達成効率要件

#### 3.3.2 [#15] 最大許容デバイス温度条件

##### 3.3.2.1 [#24] 半導体素子

##### 3.3.2.2 [#25] 受動部品

###### 3.3.2.2.1 [#26] インダクタ

###### 3.3.2.2.2 [#27] 電解コンデンサ

### 3.4 [#8] ディレーティング

#### 3.4.1 [#16] 半導体素子

##### 3.4.1.1 [#18] 電圧ディレーティング

##### 3.4.1.2 [#19] 電流ディレーティング

##### 3.4.1.3 [#20] 電力ディレーティング

#### 3.4.2 [#17] 受動部品

##### 3.4.2.1 [#21] 電圧ディレーティング

##### 3.4.2.2 [#22] 電流ディレーティング

##### 3.4.2.3 [#23] 電力ディレーティング